# Grasshopper definition ref_WWR.gh (Grasshopper 1.0.8)
# plug-ins: Bifocals, LunchBox

path = FilePath("C:\Users\nickg\Desktop\Local Files\CodeProjects\JupiterNotebooks\AAAO\variables.csv")
panel = Panel(path)
file = ReadFile(File=path, PerLineParse=True)
csv = ReadCSV(CSVString=file, Delimiter=",")  # -> Headers, Values
item = ListItem(List=csv.Values, Index=0, Wrap=True)  # -> Item, Item1, Item2, Item3, Item4, Item5
panel_2 = Panel(csv.Values)
x1 = Panel(item.Item2)
x2 = Panel(item.Item3)
bang = ExplodeTree(Data=x1)  # -> Branch0, Branch1
bang_2 = ExplodeTree(Data=x2)  # -> Branch0, Branch1

xy_plane = XYPlane(Origin=Point(0, 0, 0))
unit_z = UnitZ(Factor="3")
move = Move(Geometry=xy_plane, Motion=unit_z)  # -> Geometry, Transform

number_slider = Slider(-2.08, range=-3..3)
unit_y = UnitY(Factor=bang.Branch1)

# ----
# Varibles
number_slider_2 = Slider(0.66, range=-3..3)
unit_x = UnitX(Factor=bang.Branch0)

number_slider_3 = Slider(-1.43, range=-3..2)
unit_y_2 = UnitY(Factor=bang_2.Branch1)

# ----
# Varibles
number_slider_4 = Slider(0.37, range=-3..3)
unit_x_2 = UnitX(Factor=bang_2.Branch0)

point = Point(Point(-3.999269847, 6.500122633, 3))
move_2 = Move(Geometry=point, Motion=unit_x_2)  # -> Geometry, Transform
move_3 = Move(Geometry=move_2.Geometry, Motion=unit_y_2)  # -> Geometry, Transform

point_2 = Point(Point(-4, 3.052782138, 3))
move_4 = Move(Geometry=point_2, Motion=unit_x)  # -> Geometry, Transform
move_5 = Move(Geometry=move_4.Geometry, Motion=unit_y)  # -> Geometry, Transform

# ----
# Skyligth-1
rectangle_2pt = Rectangle2Pt(Plane=move.Geometry, PointA=move_5.Geometry, PointB=move_3.Geometry, Radius=0)  # -> Rectangle, Length

# ----
# Other openings
# 4 Windows + 2 Skyligths
brep = Brep([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])

# ----
# All openings
entwine = Entwine(Branch00=rectangle_2pt.Rectangle, Branch01=brep, FlattenInputs=True)  # -> flatten(Result)
# Geometry Preparation
brep_2 = Brep(entwine)

# ---- group: Opaque Faces
# Buildings
geo = Geometry([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])
roomsolid = HBRoomFromSolid(geo=flatten(geo), name="TestRoom", conditioned=True)  # -> report, rooms; plug-in component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

# ----
debrep = DeconstructBrep(Brep=geo)  # -> reparameterize(flatten(Faces)), Edges, Vertices

# ---- group: Apertures
# Openings
panel_3 = Panel("g_material")
glassmod = HBGlassModifier(name=panel_3, trans="0.55")  # -> modifier; plug-in component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
aperture = HBAperture(geo=brep_2, rad_mod=glassmod)  # -> report, apertures; plug-in component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
addsubface = HBAddSubface(hb_obj=flatten(roomsolid.rooms), sub_faces=flatten(aperture.apertures))  # -> hb_obj; plug-in component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
bordershades = HBExtrudedBorderShades(hb_objs=flatten(addsubface), depth="0.3")  # -> report, hb_objs; plug-in component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

# ----
cull_i = CullIndex(List=debrep.Faces, Indices=[Slider(4, range=0..10), Slider(10, range=0..10)], Wrap=True)

# ---- group: Context!
# Shading buildings
brep_3 = Brep([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])
shade = HBShade(geo=brep_3)  # -> report, shades; plug-in component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

# ----
item_2 = ListItem(List=cull_i, Index=0, Wrap=True)  # -> Item1, Item, Item1_2, Item2, Item3, Item4, Item5, Item6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
cluster = Cluster_2(
    A_2=Slider(0.60328, range=0.05..0.95),
    B_2=Slider(0.27739, range=0.05..0.95),
    S=item_2.Item3,
    A=Slider(0.78657, range=0.05..0.95),
    B=Slider(0.29386, range=0.05..0.95))
cluster_2 = Cluster_2(
    A_2=Slider(0.60328, range=0.05..0.95),
    B_2=Slider(0.27739, range=0.05..0.95),
    S=item_2.Item8,
    A=Slider(0.78657, range=0.05..0.95),
    B=Slider(0.29386, range=0.05..0.95))
cluster_3 = Cluster(
    A=Slider(0.13606, range=0.05..0.95),
    B=Slider(0.27739, range=0.05..0.95),
    S=item_2.Item,
    A_2=Slider(0.78657, range=0.05..0.95),
    B_2=Slider(0.29386, range=0.05..0.95))
cluster_4 = Cluster_2(
    A_2=Slider(0.60328, range=0.05..0.95),
    B_2=Slider(0.27739, range=0.05..0.95),
    S=item_2.Item1_2,
    A=Slider(0.78657, range=0.05..0.95),
    B=Slider(0.29386, range=0.05..0.95))
cluster_5 = Cluster_2(
    A_2=Slider(0.60328, range=0.05..0.95),
    B_2=Slider(0.27739, range=0.05..0.95),
    S=item_2.Item7,
    A=Slider(0.78657, range=0.05..0.95),
    B=Slider(0.29386, range=0.05..0.95))
cluster_6 = Cluster_2(
    A_2=Slider(0.60328, range=0.05..0.95),
    B_2=Slider(0.27739, range=0.05..0.95),
    S=item_2.Item9,
    A=Slider(0.78657, range=0.05..0.95),
    B=Slider(0.29386, range=0.05..0.95))
cluster_7 = Cluster_2(
    A_2=Slider(0.60328, range=0.05..0.95),
    B_2=Slider(0.27739, range=0.05..0.95),
    S=item_2.Item2,
    A=Slider(0.78657, range=0.05..0.95),
    B=Slider(0.29386, range=0.05..0.95))
cluster_8 = Cluster_2(
    A_2=Slider(0.60328, range=0.05..0.95),
    B_2=Slider(0.27739, range=0.05..0.95),
    S=item_2.Item4,
    A=Slider(0.78657, range=0.05..0.95),
    B=Slider(0.29386, range=0.05..0.95))
cluster_9 = Cluster_2(
    A_2=Slider(0.60328, range=0.05..0.95),
    B_2=Slider(0.27739, range=0.05..0.95),
    S=item_2.Item5,
    A=Slider(0.78657, range=0.05..0.95),
    B=Slider(0.29386, range=0.05..0.95))
sdivide = DivideSurface(Surface=debrep.Faces, UCount=10, VCount=10)  # -> Points, Normals, Parameters
cluster_10 = Cluster_2(
    A_2=Slider(0.60328, range=0.05..0.95),
    B_2=Slider(0.27739, range=0.05..0.95),
    S=item_2.Item6,
    A=Slider(0.78657, range=0.05..0.95),
    B=Slider(0.29386, range=0.05..0.95))
merge = Merge(
    Data1=cluster_3,
    Data2=cluster_4,
    Data3=cluster_7,
    Data4=cluster,
    Data5=cluster_8,
    Data6=cluster_9,
    Data7=cluster_10,
    Data8=cluster_5,
    Data9=cluster_2,
    Data10=cluster_6)
area = Area(Geometry=merge)  # -> Area, Centroid

# ----
# Wea
panel_4 = Panel("https://energyplus-weather.s3.amazonaws.com/north_and_central_america_wmo_region_4/USA/MA/USA_MA_Boston-Logan.Intl.AP.725090_TMY3/USA_MA_Boston-Logan.Intl.AP.725090_TMY3.zip")
downloadepw = LBDownloadWeather(weather_URL=panel_4)  # -> epw_file, stat_file, ddy_file; plug-in component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
wea = HBWeaFromEPW(epw_file=downloadepw.epw_file)  # -> wea; plug-in component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

ma = MassAddition(Input=area.Area)  # -> Result, PartialResults

# ----
# Model + Grids
panel_5 = Panel("sample_model_grid")
model = HBModel(rooms=flatten(bordershades.hb_objs), shades=flatten(shade.shades), name=panel_5)  # -> report, model; plug-in component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
gridrooms = HBSensorGridFromRooms(rooms=bordershades.hb_objs, grid_size="0.5")  # -> grid, points, mesh; plug-in component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
assigngridsviews = HBAssignGridsAndViews(model=model.model, grids=flatten(gridrooms.grid))  # -> model; plug-in component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
vizwiref = HBVisualizeWireframe(hb_objs=flatten(model.model))  # -> geo; plug-in component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

# ----
# Run Recipe
toggle = BooleanToggle(False)
annualdaylight = HBAnnualDaylight(model=assigngridsviews, wea=wea, enhanced=toggle, run=Toggle(True))  # -> report, results, DA, cDA, UDI, UDI_low, UDI_up; plug-in component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

# ----
# Compute sDA
sda = HBSpatialDaylightAutonomy(DA=annualdaylight.DA)  # -> report, sDA, pass_fail; plug-in component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
sda_in_each_room = Panel(sda.sDA)

# ----
# Visualize Daylight Autonomy
data = Data(flatten(annualdaylight.DA))  # disabled
mjoin = MeshJoin(Meshes=gridrooms.mesh)  # disabled
panel_6 = Panel("%")  # disabled
heatmap = LBSpatialHeatmap(values=data, mesh=mjoin, legend_title=panel_6)  # -> mesh, legend, title, colors, legend_par, vis_set; disabled; plug-in component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

list_item = ListItem(List=sda.sDA, Index=0, Wrap=True)  # -> Item, Item1
spatial_daylight_autonomy_room2 = Panel(list_item.Item1)

# ----
# Objective Function
spatial_daylight_autonomy_room1 = Panel(list_item.Item)

legendpar = LBLegendParameters(num_decimals="0")  # -> leg_par; plug-in component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

# ----
# Visualize Hourly
# Illuminance for
# a Sensor
panel_7 = Panel("60")  # disabled
data_2 = Data(annualdaylight.results)  # disabled
pt = Point(gridrooms.points)  # disabled
bang_3 = ExplodeTree(Data=pt)  # -> Branch0, Branch1; disabled
item_3 = ListItem(List=bang_3.Branch0, Index=panel_7, Wrap=True)  # disabled
panel_8 = Panel("0.5")  # disabled
sph = Sphere(Base=item_3, Radius=panel_8)  # disabled
annualtodata = HBAnnualResultsToData(results=flatten(data_2), sel_pts=flatten(item_3), all_pts=pt)  # -> report, data; disabled; plug-in component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
panel_9 = Panel("50,0,0")  # disabled
hourlyplot = LBHourlyPlot(data=annualtodata.data, base_pt=panel_9, legend_par=legendpar)  # -> mesh, legend, borders, labels, title, vis_set; disabled; plug-in component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

csv_2 = CreateCSV(DataGridHeaders="SDA", ValueTree=spatial_daylight_autonomy_room1, Delimiter=",")
panel_10 = Panel(csv_2)

# ----
# Inputs
# Variables
# X
file_path = FilePath("C:\Users\mohse\.spyder-py3\ARCH509\X.csv")
panel_11 = Panel(file_path)
read_file = ReadFile(File=file_path, PerLineParse=True)  # -> flatten(Content)
read_csv = ReadCSV(CSVString=read_file, Delimiter=",")  # -> Headers, flatten(Values)
list_item_2 = ListItem(List=read_csv.Values, Index=0, Wrap=True)  # -> Item, Item1, Item2, Item3
# X0
x0 = Panel(list_item_2.Item2)
# X1
x1_2 = Panel(list_item_2.Item3)

panel_12 = Panel(read_csv.Values)

# ==== cluster Cluster
S = ClusterInput()
A = ClusterInput()
B = ClusterInput()
A_2 = ClusterInput()
B_2 = ClusterInput()
dom = ConstructDomain(DomainStart=A_2, DomainEnd=B_2)
dom_2 = ConstructDomain(DomainStart=A, DomainEnd=B)
dom² = ConstructDomain²(DomainU=dom_2, DomainV=dom)
subsrf = Isotrim(Surface=S, Domain=dom²)
S_2 = ClusterOutput(subsrf)

# ==== cluster Cluster_2
A = ClusterInput()
B = ClusterInput()
A_2 = ClusterInput()
B_2 = ClusterInput()
dom = ConstructDomain(DomainStart=A, DomainEnd=B)
dom_2 = ConstructDomain(DomainStart=A_2, DomainEnd=B_2)
dom² = ConstructDomain²(DomainU=dom_2, DomainV=dom)
S = ClusterInput()
subsrf = Isotrim(Surface=S, Domain=dom²)
S_2 = ClusterOutput(subsrf)
