# Grasshopper definition detroit_osm_elk.gh (Grasshopper 1.0.8)
# plug-ins: ElkGHComponents

osm_file = Panel("C:\Users\pearl\Downloads\Riff\GIS files_Land use Zoning\detroit_study_area.osm")
loc = Location(FilePathText=osm_file)  # -> OSMPointData, OSMFile, LongitudeDomain, LatitudeDomain
file = ReadFile(File=osm_file, PerLineParse=True)
osm = OSMData(OSMPointData=loc.OSMPointData, OSMFilePath=loc.OSMFile, Feature="building", Generate3d=False, IndividualOutputs=False)  # -> Ways, FeatureKey
